# Grasshopper definition test_data.gh (Grasshopper 1.0.7)

ghpython_script = GhPythonScript()  # -> out, a, c
# ---------- ghpython_script: Python ----------
__author__ = "drago"
__version__ = "2020.06.25"

import rhinoscriptsyntax as rs

output = []

node1 = {"id":2,"center":[1,1.5,0],"floorArea":6,"roomtype":"P",
        "totalGWP": 34,
       "wall_S":{"composition":[0.5,0.4,0.1],
                "vertices":[[[0,0,0],[1,0,0]],
                            [[1,0,0],[1.8,0,0]],
                            [[1.8,0,0],[2,0,0]]],
                            "material":["CP010","CP011","CP01"],
                            "GWP":[1,2,3],"halved":False},
       "wall_E":{"composition":[0.8,0.2,0],
                "vertices":[[[2,0,0],[2,2.4,0]],
                            [[2,2.4,0],[2,3,0]],
                            [[2,3,0],[2,3,0]]],
                            "material":["CP010","CP011","CP01"],
                            "GWP":[3,-2,0],"halved":False},
       "wall_N":{"composition":[0.2,0.3,0.5],
                "vertices":[[[0,3,0],[0.4,3,0]],
                            [[0.4,3,0],[1,3,0]],
                            [[1,3,0],[2,3,0]]],
                            "material":["CP011","CP011","CP01"],
                            "GWP":[4,5,1],"halved":False},
       "wall_W":{"composition":[0.5,0.4,0.1],
                "vertices":[[[0,0,0],[0,1,0]],
                            [[0,1,0],[0,1.8,0]],
                            [[0,1.8,0],[0,2,0]]],
                            "material":["CP010","CP011","CP01"],
                            "GWP":[1,2,3],"halved":False}}

node2 = {"id":3,"center":[2.5,1.5,0],"floorArea":3,"roomtype":"P",
        "totalGWP": 34,
       "wall_S":{"composition":[0.5,0.4,0.1],
                "vertices":[[[2,0,0],[2.5,0,0]],
                            [[2.5,0,0],[2.9,0,0]],
                            [[2.9,0,0],[3,0,0]]],
                            "material":["CP010","CP011","CP01"],
                            "GWP":[1,2,3],"halved":False},
       "wall_E":{"composition":[0.8,0.2,0],
                "vertices":[[[3,0,0],[3,2.4,0]],
                            [[3,2.4,0],[3,3,0]],
                            [[3,3,0],[3,3,0]]],
                            "material":["CP010","CP011","CP01"],
                            "GWP":[3,-2,0],"halved":False},
       "wall_N":{"composition":[0.2,0.3,0.5],
                "vertices":[[[2,3,0],[2.2,3,0]],
                            [[2.2,3,0],[2.5,3,0]],
                            [[2.5,3,0],[3,3,0]]],
                            "material":["CP011","CP011","CP01"],
                            "GWP":[4,5,1],"halved":False},
       "wall_W":{"composition":[0.5,0.4,0.1],
                "vertices":[[[2,0,0],[2,1,0]],
                            [[2,1,0],[2,1.8,0]],
                            [[2,1.8,0],[2,2,0]]],
                            "material":["CP010","CP011","CP01"],
                            "GWP":[1,2,3],"halved":False}}
                            
output = [node1,node2]

print(output)

a = output[0]["wall_N"]["vertices"]

c = rs.AddPolyline(a[0])
# ---------- end ghpython_script ----------
unit_z = UnitZ(Factor=3)
panel = Panel(ghpython_script.c)
extrude = Extrude(Base=ghpython_script.c, Direction=unit_z)
